# Grasshopper definition Seagrass Support Generator.gh (Grasshopper 1.0.7)
# Original seagrass support cluster, eight inputs ordered as reference image. Connect numeric inputs before solving.

seagrass_support_generator = SeagrassSupportGenerator()

# ==== cluster SeagrassSupportGenerator
relay = ClusterInput()
relay_2 = ClusterInput()
relay_3 = ClusterInput()
relay_4 = ClusterInput()
relay_5 = ClusterInput()
relay_6 = ClusterInput()
relay_7 = ClusterInput()
relay_8 = ClusterInput()
cluster = Cluster(
    count_3=relay_3,
    radius=relay,
    A_2=relay_4,
    B_2=relay_2,
    value=relay_4,
    count_2=relay_3,
    count_7=relay_3,
    A_3=relay_4,
    B_3=relay_5,
    count=relay_3,
    A_6=relay_4,
    A=relay_5,
    B=relay_6,
    count_6=relay_3,
    A_7=relay_4,
    A_4=relay_5,
    B_4=relay_7,
    count_4=relay_3,
    A_8=relay_4,
    A_5=relay_5,
    B_5=relay_8,
    count_5=relay_3)
result = ClusterOutput(cluster)

# ==== cluster Cluster
A = ClusterInput()
B = ClusterInput()
A_2 = ClusterInput()
B_2 = ClusterInput()
point = Point(Point(0, 0, 0))
A_3 = ClusterInput()
B_3 = ClusterInput()
multiplication = Multiplication(A=A, B=B)
negative = Negative(Value=Slider(0.4, range=0..1))
A_4 = ClusterInput()
B_4 = ClusterInput()
addition = Addition(A=A_2, B=B_2)
radius = ClusterInput()
A_5 = ClusterInput()
B_5 = ClusterInput()
A_6 = ClusterInput()
addition_2 = Addition(A=A_3, B=B_3)
number_slider = Slider(3.3, range=0..10)
multiplication_2 = Multiplication(A=A_4, B=B_4)
circle = Circle(Plane=PlaneXY(0, 0, 0), Radius=radius)
multiplication_3 = Multiplication(A=A_5, B=B_5)
offset_curve = OffsetCurve(Curve=circle, Distance=negative, Corners=1)
addition_3 = Addition(A=A_6, B=multiplication)
negative_2 = Negative(Value=addition)
value = ClusterInput()
A_7 = ClusterInput()
A_8 = ClusterInput()
negative_3 = Negative(Value=value)
addition_4 = Addition(A=A_7, B=multiplication_2)
merge = Merge(Data1=offset_curve, Data2=circle)
addition_5 = Addition(A=A_8, B=multiplication_3)
offset_curve_2 = OffsetCurve(Curve=circle, Distance=expr("x/2", number_slider), Corners=1)
negative_4 = Negative(Value=Slider(1.423, range=0..10))
offset_curve_3 = OffsetCurve(Curve=circle, Distance=number_slider, Corners=1)
unit_z = UnitZ(Factor=negative_2)
boundary_surfaces = BoundarySurfaces(Edges=flatten(merge))
unit_z_2 = UnitZ(Factor=negative_3)
amplitude = Amplitude(Vector=unit_z_2, Amplitude=addition_2)
amplitude_2 = Amplitude(Vector=unit_z_2, Amplitude=addition_3)
amplitude_3 = Amplitude(Vector=unit_z_2, Amplitude=addition_4)
amplitude_4 = Amplitude(Vector=unit_z_2, Amplitude=addition_5)
number_slider_2 = Slider(0.635, range=0..10)
number_slider_3 = Slider(0.6, range=0..1)
number_slider_4 = Slider(1.724, range=0..10)
merge_2 = Merge(Data1=offset_curve_3, Data2=circle)
unit_z_3 = UnitZ(Factor=number_slider_4)
number_slider_5 = Slider(6, range=0..10)
unit_z_4 = UnitZ(Factor=expr("x/2", number_slider_4))
unit_z_5 = UnitZ(Factor=expr("x/2", number_slider_4))
boundary_surfaces_2 = BoundarySurfaces(Edges=flatten(merge_2))
number_slider_6 = Slider(6, range=0..10)
unit_z_6 = UnitZ(Factor=number_slider_4)
count = ClusterInput()
count_2 = ClusterInput()
count_3 = ClusterInput()
count_4 = ClusterInput()
count_5 = ClusterInput()
count_6 = ClusterInput()
number_slider_7 = Slider(1, range=0..1)
negative_5 = Negative(Value=number_slider_4)
number_slider_8 = Slider(0.2, range=0..1)
polygon = Polygon(Plane=PlaneXY(0, 0, 0), Radius=Slider(18.6, range=0..100), Segments=number_slider_6, FilletRadius=number_slider_8)  # -> Polygon, Length
polygon_2 = Polygon(Plane=PlaneXY(0, 0, 0), Radius=Slider(16, range=0..100), Segments=number_slider_6, FilletRadius=number_slider_8)  # -> Polygon, Length
polygon_3 = Polygon(Plane=PlaneXY(0, 0, 0), Radius=Slider(12, range=0..100), Segments=number_slider_6, FilletRadius=number_slider_8)  # -> Polygon, Length
polygon_4 = Polygon(Plane=PlaneXY(0, 0, 0), Radius=Slider(6.6, range=0..100), Segments=number_slider_6, FilletRadius=number_slider_8)  # -> Polygon, Length
move = Move(Geometry=polygon.Polygon, Motion=amplitude)  # -> Geometry, Transform
move_2 = Move(Geometry=polygon_2.Polygon, Motion=amplitude_2)  # -> Geometry, Transform
offset_curve_4 = OffsetCurve(Curve=move.Geometry, Distance=expr("x/2", number_slider), Corners=1)
move_3 = Move(Geometry=polygon_3.Polygon, Motion=amplitude_3)  # -> Geometry, Transform
offset_curve_5 = OffsetCurve(Curve=move_3.Geometry, Distance=expr("x/2", number_slider), Corners=1)
move_4 = Move(Geometry=polygon_4.Polygon, Motion=amplitude_4)  # -> Geometry, Transform
offset_curve_6 = OffsetCurve(Curve=move_4.Geometry, Distance=expr("x/2", number_slider), Corners=1)
offset_curve_7 = OffsetCurve(Curve=move.Geometry, Distance=number_slider, Corners=1)
offset_curve_8 = OffsetCurve(Curve=move_2.Geometry, Distance=expr("x/2", number_slider), Corners=1)
polygon_5 = Polygon(Plane=PlaneXY(0, 0, 0), Radius=Slider(22, range=0..100), Segments=number_slider_6, FilletRadius=number_slider_8)  # -> Polygon, Length
offset_curve_9 = OffsetCurve(Curve=move_2.Geometry, Distance=number_slider, Corners=1)
move_5 = Move(Geometry=offset_curve_5, Motion=unit_z_4)  # -> Geometry, Transform
move_6 = Move(Geometry=offset_curve_6, Motion=unit_z_5)  # -> Geometry, Transform
boundary_surfaces_3 = BoundarySurfaces(Edges=move_4.Geometry)
offset_curve_10 = OffsetCurve(Curve=move_3.Geometry, Distance=number_slider, Corners=1)
offset_curve_11 = OffsetCurve(Curve=move_4.Geometry, Distance=number_slider, Corners=1)
merge_3 = Merge(Data1=move.Geometry, Data2=offset_curve_7)
divide_curve = DivideCurve(Curve=offset_curve_4, Count=count, Kinks=False)  # -> Points, Tangents, Parameters
move_7 = Move(Geometry=polygon_5.Polygon, Motion=unit_z_2)  # -> Geometry, Transform
merge_4 = Merge(Data1=move_2.Geometry, Data2=offset_curve_9)
divide_curve_2 = DivideCurve(Curve=move_5.Geometry, Count=count_4, Kinks=False)  # -> Points, Tangents, Parameters
divide_curve_3 = DivideCurve(Curve=move_6.Geometry, Count=count_5, Kinks=False)  # -> Points, Tangents, Parameters
divide_curve_4 = DivideCurve(Curve=offset_curve_8, Count=count_6, Kinks=False)  # -> Points, Tangents, Parameters
boundary_surfaces_4 = BoundarySurfaces(Edges=flatten(merge_3))
unit_z_7 = UnitZ(Factor=expr("x*2", negative_5))
merge_5 = Merge(Data1=move_3.Geometry, Data2=offset_curve_10)
boundary_surfaces_5 = BoundarySurfaces(Edges=flatten(merge_4))
offset_curve_12 = OffsetCurve(Curve=move_7.Geometry, Distance=expr("x/2", number_slider), Corners=1)
merge_6 = Merge(Data1=move_4.Geometry, Data2=offset_curve_11)
move_8 = Move(Geometry=offset_curve_3, Motion=expr("x/2", unit_z_3))  # -> Geometry, Transform
divide_curve_5 = DivideCurve(Curve=move_8.Geometry, Count=count_3, Kinks=False)  # -> Points, Tangents, Parameters
line = Line(StartPoint=graft(divide_curve_5.Points), EndPoint=point)
point_2 = Point(graft(divide_curve_5.Points))
offset_curve_13 = OffsetCurve(Curve=move_7.Geometry, Distance=expr("x*1.5", number_slider), Corners=1)
merge_7 = Merge(Data1=offset_curve_13, Data2=move_7.Geometry)
boundary_surfaces_6 = BoundarySurfaces(Edges=flatten(merge_5))
boundary_surfaces_7 = BoundarySurfaces(Edges=flatten(merge_6))
number_slider_9 = Slider(0.05, range=0..0.1)
count_7 = ClusterInput()
divide_curve_6 = DivideCurve(Curve=offset_curve_12, Count=count_7, Kinks=False)  # -> Points, Tangents, Parameters
line_2 = Line(StartPoint=divide_curve.Points, EndPoint=divide_curve_4.Points)  # -> graft(Line)
unit_z_8 = UnitZ(Factor=expr("x*2", unit_z_6))
boundary_surfaces_8 = BoundarySurfaces(Edges=flatten(merge_7))
line_3 = Line(StartPoint=divide_curve_4.Points, EndPoint=divide_curve_2.Points)  # -> graft(Line)
line_4 = Line(StartPoint=divide_curve_2.Points, EndPoint=divide_curve_3.Points)  # -> graft(Line)
move_9 = Move(Geometry=divide_curve_6.Points, Motion=unit_z_4)  # -> Geometry, Transform
line_5 = Line(StartPoint=move_9.Geometry, EndPoint=divide_curve.Points)  # -> graft(Line)
circle_2 = Circle(Plane=divide_curve_6.Points, Radius=expr("x/2", number_slider))
number_slider_10 = Slider(6, range=0..10)
number_slider_11 = Slider(1, range=0..1)
move_10 = Move(Geometry=circle_2, Motion=unit_z_8)  # -> graft(Geometry), Transform
area = Area(Geometry=move_10.Geometry)  # -> Area, Centroid
line_6 = Line(StartPoint=graft(divide_curve_5.Points), EndPoint=area.Centroid)
evaluate_curve = EvaluateCurve(Curve=line_6, Parameter=Slider(0.5, range=0..1))  # -> Point, Tangent, Angle
plane_3pt = Plane3Pt(PointA=divide_curve_5.Points, PointB=flatten(area.Centroid), PointC=point)
rotate = Rotate(Geometry=flatten(line_6), Angle=1.570796327, Plane=plane_3pt)  # -> graft(Geometry), Transform
point_3 = Point(area.Centroid)
end_points = EndPoints(Curve=rotate.Geometry)  # -> Start, End
vector_2pt = Vector2Pt(PointA=end_points.Start, PointB=end_points.End, Unitize=True)  # -> Vector, Length
multiplication_4 = Multiplication(A=vector_2pt.Vector, B=negative_4)
move_11 = Move(Geometry=evaluate_curve.Point, Motion=multiplication_4)  # -> Geometry, Transform
data = Data([point_2, move_11.Geometry, point_3])
interpolate_t = InterpolateT(Vertices=data, TangentStart=Vector(0, 0, 0), TangentEnd=Vector(0, 0, 0), KnotStyle=1)  # -> Curve, Length, Domain
extend_curve = ExtendCurve(Curve=interpolate_t.Curve, Type=Slider(1, range=0..10), Start=number_slider_2, End=number_slider_2)
divide_curve_7 = DivideCurve(Curve=interpolate_t.Curve, Count=expr("x/4", count_2), Kinks=False)  # -> Points, Tangents, Parameters
flip_matrix = FlipMatrix(Data=divide_curve_7.Points)
perp_frame = PerpFrame(Curve=reparameterize(extend_curve), Parameter=Slider(0, range=0..100))
polygon_6 = Polygon(Plane=perp_frame, Radius=number_slider_3, Segments=number_slider_5, FilletRadius=number_slider_9)  # -> Polygon, Length
split_tree = SplitTree(Data=flip_matrix, Masks=flatten("{0;0;0;0;0}"))  # -> Positive, Negative
path_mapper = PathMapper(split_tree.Negative, source="{A;B;C;D;E}", target="{A;B;C;path_count-D;E}")
split_tree_2 = SplitTree(Data=path_mapper, Masks=flatten("{0;0;0;0;0}"))  # -> Positive, Negative
point_4 = Point(simplify(graft(split_tree_2.Negative)))
data_2 = Data(point_4)
path_mapper_2 = PathMapper(data_2, source="{A;B}", target="{A}")
point_5 = Point(graft(path_mapper_2))
path_mapper_3 = PathMapper(path_mapper_2, source="{A}(i)", target="{A}((i+1)%item_count)")
point_6 = Point(graft(path_mapper_3))
merge_8 = Merge(Data1=point_6, Data2=point_5)
polyline = PolyLine(Vertices=merge_8, Closed=False)
perp_frame_2 = PerpFrame(Curve=polyline, Parameter=Slider(0, range=0..100))
polygon_7 = Polygon(Plane=perp_frame_2, Radius=number_slider_3, Segments=number_slider_5, FilletRadius=number_slider_9)  # -> Polygon, Length
polygon_8 = Polygon(Plane=divide_curve_4.Points, Radius=number_slider_11, Segments=number_slider_10, FilletRadius=0)  # -> graft(Polygon), Length
polygon_9 = Polygon(Plane=move_9.Geometry, Radius=number_slider_11, Segments=number_slider_10, FilletRadius=0)  # -> graft(Polygon), Length
polygon_10 = Polygon(Plane=divide_curve.Points, Radius=number_slider_11, Segments=number_slider_10, FilletRadius=0)  # -> graft(Polygon), Length
polygon_11 = Polygon(Plane=divide_curve_2.Points, Radius=number_slider_11, Segments=number_slider_10, FilletRadius=0)  # -> graft(Polygon), Length

sweep1 = Sweep1(Rail=line_5, Sections=polygon_9.Polygon, Miter=1)
sweep1_2 = Sweep1(Rail=extend_curve, Sections=polygon_6.Polygon, Miter=1)
extrude = Extrude(Base=boundary_surfaces_2, Direction=unit_z_6)
sweep1_3 = Sweep1(Rail=polyline, Sections=polygon_7.Polygon, Miter=1)
extrude_2 = Extrude(Base=boundary_surfaces_8, Direction=unit_z_8)
extrude_3 = Extrude(Base=boundary_surfaces, Direction=unit_z)
sweep1_4 = Sweep1(Rail=line_2, Sections=polygon_10.Polygon, Miter=1)
extrude_4 = Extrude(Base=boundary_surfaces_8, Direction=unit_z_7)
sweep1_5 = Sweep1(Rail=line_4, Sections=polygon_11.Polygon, Miter=1)
extrude_5 = Extrude(Base=boundary_surfaces_6, Direction=unit_z_6)
extrude_6 = Extrude(Base=boundary_surfaces_4, Direction=unit_z_6)
sweep1_6 = Sweep1(Rail=line_3, Sections=polygon_8.Polygon, Miter=1)
extrude_7 = Extrude(Base=boundary_surfaces_7, Direction=unit_z_6)
extrude_8 = Extrude(Base=boundary_surfaces_5, Direction=unit_z_6)
extrude_9 = Extrude(Base=boundary_surfaces_3, Direction=unit_z_6)

merge_9 = Merge(
    Data1=extrude_4,
    Data2=extrude_2,
    Data3=sweep1_3,
    Data4=sweep1_2,
    Data5=sweep1,
    Data6=sweep1_4,
    Data7=sweep1_6,
    Data8=sweep1_5,
    Data9=extrude_5,
    Data10=extrude_8,
    Data11=extrude_7,
    Data12=extrude_6,
    Data13=extrude_9,
    Data14=extrude,
    Data15=extrude_3)
result = ClusterOutput(merge_9)
