# Grasshopper definition parameter layout generator.ghx (Grasshopper 1.0.7)
# Original v3 rebuilt with per-support generator parameters and persistent override table.

# V4 | INDIVIDUAL SUPPORT PARAMETERS
# Copy a Catalog row to the Overrides panel (Status column is ignored).
# Edit any of the 13 fields; blank = global default.
# ID follows the original XY position + direction + layout mode, not output index.
# Layout/guide changes can invalidate IDs; see unused-ID warnings.
# Save the GH file to retain edits. Labels output shows support IDs.
# Original parameter semantics retained; no structural validation.
pod_radius_default = Slider(15, range=1..100)
pod_depth_default = Slider(8, range=0.5..100)
openings_default = Slider(6, range=3..30)
module_height_default = Slider(30, range=1..200)
layer_1_default = Slider(1, range=0.1..10)
layer_2_default = Slider(2, range=0.1..10)
layer_3_default = Slider(3, range=0.1..10)
layer_4_default = Slider(4, range=0.1..10)
terrain_optional_replacement = TerrainOptionalReplacement()
panel = Panel("""# Per-support overrides. Copy a Catalog row below this header.
# Blank field = global default. Enabled: 0 hide / 1 show.
ID,Radius,Depth,Openings,Height,Layer1,Layer2,Layer3,Layer4,Yaw,OffsetX,OffsetY,Gap,Enabled""")
original_four_layer_support = SeagrassSupportGenerator(
    relay=pod_radius_default,
    relay_2=pod_depth_default,
    relay_3=openings_default,
    relay_4=module_height_default,
    relay_5=layer_1_default,
    relay_6=layer_2_default,
    relay_7=layer_3_default,
    relay_8=layer_4_default)
terrain_embedded_sample = PythonScript(T=flatten(terrain_optional_replacement))  # -> TerrainMesh; inputs T: list
# ---------- terrain_embedded_sample: Python ----------
import Rhino.Geometry as rg
import rhinoscriptsyntax as rs
import base64, struct
TerrainMesh=rg.Mesh()
if T:
    for g in T:
        if hasattr(g,'ScriptVariable'): g=g.ScriptVariable()
        if not isinstance(g,rg.GeometryBase): g=rs.coercegeometry(g)
        if isinstance(g,rg.Mesh): TerrainMesh.Append(g)
        elif isinstance(g,rg.Brep):
            for m in rg.Mesh.CreateFromBrep(g,rg.MeshingParameters.Default): TerrainMesh.Append(m)
        elif isinstance(g,rg.Surface):
            for m in rg.Mesh.CreateFromBrep(g.ToBrep(),rg.MeshingParameters.Default): TerrainMesh.Append(m)
        else: raise ValueError('Terrain input accepts meshes, surfaces or Breps')
else:
    b=base64.b64decode('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')
    n=struct.unpack_from('<I',b,80)[0]
    for i in range(n):
        k=TerrainMesh.Vertices.Count
        for j in range(3):
            x,y,z=struct.unpack_from('<3f',b,84+50*i+12+12*j)
            TerrainMesh.Vertices.Add(x,y,z)
        TerrainMesh.Faces.AddFace(k,k+1,k+2)
TerrainMesh.Vertices.CombineIdentical(True,True)
TerrainMesh.Normals.ComputeNormals()
TerrainMesh.Compact()
# ---------- end terrain_embedded_sample ----------
mode = Slider(0, range=0..3)
dx = Slider(180, range=1..1000)
dy = Slider(180, range=1..1000)
angle = Slider(0, range=-180..180)
shift = Slider(0.5, range=0..1)
gap = Slider(0, range=0..100)
margin = Slider(5, range=0..100)
maxrelief = Slider(30, range=0..200)
contourstep = Slider(20, range=0.1..200)
maxcount = Slider(100, range=1..500)
guide_gully_centerline = Curve()
boundary_optional_closed_curve = BoundaryOptionalClosedCurve()
individual_support_terrain_layout_v4 = PythonScript(
    T=terrain_embedded_sample,
    G=flatten(original_four_layer_support),
    Boundary=boundary_optional_closed_curve,
    Guide=guide_gully_centerline,
    Mode=mode,
    DX=dx,
    DY=dy,
    Angle=angle,
    Shift=shift,
    Gap=gap,
    Margin=margin,
    MaxRelief=maxrelief,
    ContourStep=contourstep,
    MaxCount=maxcount,
    Overrides=flatten(panel),
    DefaultRadius=pod_radius_default,
    DefaultDepth=pod_depth_default,
    DefaultOpenings=openings_default,
    DefaultHeight=module_height_default,
    DefaultLayer1=layer_1_default,
    DefaultLayer2=layer_2_default,
    DefaultLayer3=layer_3_default,
    DefaultLayer4=layer_4_default)  # -> Placed, Centers, Frames, Relief, Rejected, Report, IDs, Labels, Catalog; inputs G: list, Overrides: list
# ---------- individual_support_terrain_layout_v4: Python ----------
"""Pure Python 2.7/3 compatible terrain placement mathematics. Units: cm."""
import math

def clip(poly, axis, limit, keep_greater):
    if not poly: return []
    out=[]
    a=poly[-1]
    ain=(a[axis]>=limit) if keep_greater else (a[axis]<=limit)
    for b in poly:
        bin=(b[axis]>=limit) if keep_greater else (b[axis]<=limit)
        if ain != bin:
            t=(limit-a[axis])/(b[axis]-a[axis])
            out.append(tuple(a[k]+t*(b[k]-a[k]) for k in range(3)))
        if bin: out.append(b)
        a,ain=b,bin
    return out

class TerrainIndex(object):
    def __init__(self, triangles, cell):
        if cell<=0: raise ValueError('Index cell must be positive')
        self.triangles=triangles
        self.cell=cell
        self.bins={}
        self.x0=min(p[0] for t in triangles for p in t)
        self.y0=min(p[1] for t in triangles for p in t)
        self.x1=max(p[0] for t in triangles for p in t)
        self.y1=max(p[1] for t in triangles for p in t)
        for i,t in enumerate(triangles):
            for key in self.keys(min(p[0] for p in t),min(p[1] for p in t),max(p[0] for p in t),max(p[1] for p in t)):
                self.bins.setdefault(key,[]).append(i)
    def keys(self,x0,y0,x1,y1):
        for i in range(int(math.floor(x0/self.cell)),int(math.floor(x1/self.cell))+1):
            for j in range(int(math.floor(y0/self.cell)),int(math.floor(y1/self.cell))+1): yield (i,j)
    def height(self,x,y):
        z=None
        key=(int(math.floor(x/self.cell)),int(math.floor(y/self.cell)))
        for i in self.bins.get(key,[]):
            a,b,c=self.triangles[i]
            d=(b[1]-c[1])*(a[0]-c[0])+(c[0]-b[0])*(a[1]-c[1])
            if abs(d)<1e-12: continue
            u=((b[1]-c[1])*(x-c[0])+(c[0]-b[0])*(y-c[1]))/d
            v=((c[1]-a[1])*(x-c[0])+(a[0]-c[0])*(y-c[1]))/d
            if u>=-1e-9 and v>=-1e-9 and u+v<=1+1e-9:
                h=u*a[2]+v*b[2]+(1-u-v)*c[2]
                z=h if z is None else max(z,h)
        return z
    def footprint(self,x,y,yaw,hx,hy,n=7):
        co,si=math.cos(yaw),math.sin(yaw)
        samples=[]
        for i in range(n):
            for j in range(n):
                u=-hx+2*hx*i/(n-1); v=-hy+2*hy*j/(n-1)
                z=self.height(x+co*u-si*v,y+si*u+co*v)
                if z is None: return None
                samples.append(z)
        # Exact maximum on every projected triangle clipped to the footprint.
        rx=abs(co)*hx+abs(si)*hy; ry=abs(si)*hx+abs(co)*hy
        ids=set()
        for key in self.keys(x-rx,y-ry,x+rx,y+ry): ids.update(self.bins.get(key,[]))
        zmax=max(samples)
        for i in ids:
            poly=[(co*(p[0]-x)+si*(p[1]-y),-si*(p[0]-x)+co*(p[1]-y),p[2]) for p in self.triangles[i]]
            for ax,lim,greater in [(0,-hx,True),(0,hx,False),(1,-hy,True),(1,hy,False)]: poly=clip(poly,ax,lim,greater)
            if poly: zmax=max(zmax,max(p[2] for p in poly))
        relief=zmax-min(samples)
        return zmax, 0.0 if relief<1e-8 else relief

    def depression(self,x,y,radius,samples=16):
        """Ring mean minus center: positive for bowls/valleys, zero on a plane.

        Require a full ring so a missing uphill/downhill side cannot bias the score.
        This is local concavity at the chosen scale, not hydrological basin depth.
        """
        if radius<=0: raise ValueError('Depression radius must be positive')
        center=self.height(x,y)
        if center is None: return None
        heights=[]
        for i in range(samples):
            a=2*math.pi*i/samples
            h=self.height(x+radius*math.cos(a),y+radius*math.sin(a))
            if h is None: return None
            heights.append(h)
        return sum(heights)/samples-center

def grid_candidates(bounds,dx,dy,angle,stagger):
    co,si=math.cos(angle),math.sin(angle)
    x0,y0,x1,y1=bounds
    ox,oy=(x0+x1)/2,(y0+y1)/2
    pts=[(co*(x-ox)+si*(y-oy),-si*(x-ox)+co*(y-oy)) for x in [x0,x1] for y in [y0,y1]]
    u0,v0=min(p[0] for p in pts),min(p[1] for p in pts)
    u1,v1=max(p[0] for p in pts),max(p[1] for p in pts)
    nx=int(math.ceil((u1-u0)/dx)); ny=int(math.ceil((v1-v0)/dy))
    if (nx+1)*(ny+1)>20000: raise ValueError('More than 20000 candidates: increase spacing')
    for row in range(ny+1):
        v=v0+row*dy
        for col in range(nx+1):
            u=u0+col*dx+(row%2)*stagger*dx
            yield (ox+co*u-si*v,oy+si*u+co*v,angle,row,col)

SUPPORT_XML='<Archive name="Root">\n  <items count="1">\n    <item name="ArchiveVersion" type_name="gh_version" type_code="80">\n      <Major>0</Major>\n      <Minor>2</Minor>\n      <Revision>2</Revision>\n    </item>\n  </items>\n  <chunks count="1">\n    <chunk name="Definition">\n      <items count="1">\n        <item name="plugin_version" type_name="gh_version" type_code="80">\n          <Major>1</Major>\n          <Minor>0</Minor>\n          <Revision>7</Revision>\n        </item>\n      </items>\n      <chunks count="4">\n        <chunk name="DocumentHeader">\n          <items count="5">\n            <item name="Preview" type_name="gh_string" type_code="10">Shaded</item>\n            <item name="PreviewMeshType" type_name="gh_int32" type_code="3">1</item>\n            <item name="PreviewNormal" type_name="gh_drawing_color" type_code="36">\n              <ARGB>100;150;0;0</ARGB>\n            </item>\n            <item name="PreviewSelected" type_name="gh_drawing_color" type_code="36">\n              <ARGB>100;0;150;0</ARGB>\n            </item>\n            <item name="DocumentID" type_name="gh_guid" type_code="9">584a3303-53fc-4e6b-9546-ac05d7c2ae17</item>\n          </items>\n        </chunk>\n        <chunk name="DefinitionProperties">\n          <items count="4">\n            <item name="Date" type_name="gh_date" type_code="8">639227467149853019</item>\n            <item name="KeepOpen" type_name="gh_bool" type_code="1">false</item>\n            <item name="Name" type_name="gh_string" type_code="10">Seagrass_Terrain_Layout_Gully_v3.gh</item>\n            <item name="Description" type_name="gh_string" type_code="10">Horizontal four-layer support; four terrain layout modes. Runtime validation pending.</item>\n          </items>\n          <chunks count="3">\n            <chunk name="Revisions">\n              <items count="1">\n                <item name="RevisionCount" type_name="gh_int32" type_code="3">0</item>\n              </items>\n            </chunk>\n            <chunk name="Projection">\n              <items count="2">\n                <item name="Target" type_name="gh_drawing_point" type_code="30">\n                  <X>79</X>\n                  <Y>518</Y>\n                </item>\n                <item name="Zoom" type_name="gh_single" type_code="5">0.65</item>\n              </items>\n            </chunk>\n            <chunk name="Views">\n              <items count="1">\n                <item name="ViewCount" type_name="gh_int32" type_code="3">0</item>\n              </items>\n            </chunk>\n          </chunks>\n        </chunk>\n        <chunk name="RcpLayout">\n          <items count="1">\n            <item name="GroupCount" type_name="gh_int32" type_code="3">0</item>\n          </items>\n        </chunk>\n        <chunk name="DefinitionObjects">\n          <items count="1">\n            <item name="ObjectCount" type_name="gh_int32" type_code="3">9</item></items>\n          <chunks count="9">\n            <chunk name="Object" index="0">\n              <items count="2">\n                <item name="GUID" type_name="gh_guid" type_code="9">57da07bd-ecab-415d-9d86-af36d7073abc</item>\n                <item name="Name" type_name="gh_string" type_code="10">Number Slider</item>\n              </items>\n              <chunks count="1">\n                <chunk name="Container">\n                  <items count="6">\n                    <item name="Description" type_name="gh_string" type_code="10">Numeric slider for single values</item>\n                    <item name="Name" type_name="gh_string" type_code="10">Number Slider</item>\n                    <item name="Optional" type_name="gh_bool" type_code="1">false</item>\n                    <item name="SourceCount" type_name="gh_int32" type_code="3">0</item>\n                    <item name="InstanceGuid" type_name="gh_guid" type_code="9">3fe12075-90bc-4039-8d6d-99890d90a191</item>\n                    <item name="NickName" type_name="gh_string" type_code="10">Pod Radius (example)</item>\n                  </items>\n                  <chunks count="2">\n                    <chunk name="Attributes">\n                      <items count="2">\n                        <item name="Pivot" type_name="gh_drawing_pointf" type_code="31">\n                          <X>140</X>\n                          <Y>140</Y>\n                        </item>\n                        <item name="Bounds" type_name="gh_drawing_rectanglef" type_code="35">\n                          <X>10.0</X>\n                          <Y>130.0</Y>\n                          <W>260</W>\n                          <H>20</H>\n                        </item>\n                      </items>\n                    </chunk>\n                    <chunk name="Slider">\n                      <items count="7">\n                        <item name="GripDisplay" type_name="gh_int32" type_code="3">1</item>\n                        <item name="SnapCount" type_name="gh_int32" type_code="3">0</item>\n                        <item name="Value" type_name="gh_double" type_code="6">15</item>\n                        <item name="Min" type_name="gh_double" type_code="6">1</item>\n                        <item name="Max" type_name="gh_double" type_code="6">100</item>\n                        <item name="Interval" type_name="gh_int32" type_code="3">0</item>\n                        <item name="Digits" type_name="gh_int32" type_code="3">2</item>\n                      </items>\n                    </chunk>\n                  </chunks>\n                </chunk>\n              </chunks>\n            </chunk>\n            <chunk name="Object" index="1">\n              <items count="2">\n                <item name="GUID" type_name="gh_guid" type_code="9">57da07bd-ecab-415d-9d86-af36d7073abc</item>\n                <item name="Name" type_name="gh_string" type_code="10">Number Slider</item>\n              </items>\n              <chunks count="1">\n                <chunk name="Container">\n                  <items count="6">\n                    <item name="Description" type_name="gh_string" type_code="10">Numeric slider for single values</item>\n                    <item name="Name" type_name="gh_string" type_code="10">Number Slider</item>\n                    <item name="Optional" type_name="gh_bool" type_code="1">false</item>\n                    <item name="SourceCount" type_name="gh_int32" type_code="3">0</item>\n                    <item name="InstanceGuid" type_name="gh_guid" type_code="9">1f0c82f2-40df-4e7e-ac77-fb34c44228d1</item>\n                    <item name="NickName" type_name="gh_string" type_code="10">Pod Depth (example)</item>\n                  </items>\n                  <chunks count="2">\n                    <chunk name="Attributes">\n                      <items count="2">\n                        <item name="Pivot" type_name="gh_drawing_pointf" type_code="31">\n                          <X>140</X>\n                          <Y>180</Y>\n                        </item>\n                        <item name="Bounds" type_name="gh_drawing_rectanglef" type_code="35">\n                          <X>10.0</X>\n                          <Y>170.0</Y>\n                          <W>260</W>\n                          <H>20</H>\n                        </item>\n                      </items>\n                    </chunk>\n                    <chunk name="Slider">\n                      <items count="7">\n                        <item name="GripDisplay" type_name="gh_int32" type_code="3">1</item>\n                        <item name="SnapCount" type_name="gh_int32" type_code="3">0</item>\n                        <item name="Value" type_name="gh_double" type_code="6">8</item>\n                        <item name="Min" type_name="gh_double" type_code="6">0.5</item>\n                        <item name="Max" type_name="gh_double" type_code="6">100</item>\n                        <item name="Interval" type_name="gh_int32" type_code="3">0</item>\n                        <item name="Digits" type_name="gh_int32" type_code="3">2</item>\n                      </items>\n                    </chunk>\n                  </chunks>\n                </chunk>\n              </chunks>\n            </chunk>\n            <chunk name="Object" index="2">\n              <items count="2">\n                <item name="GUID" type_name="gh_guid" type_code="9">57da07bd-ecab-415d-9d86-af36d7073abc</item>\n                <item name="Name" type_name="gh_string" type_code="10">Number Slider</item>\n              </items>\n              <chunks count="1">\n                <chunk name="Container">\n                  <items count="6">\n                    <item name="Description" type_name="gh_string" type_code="10">Numeric slider for single values</item>\n                    <item name="Name" type_name="gh_string" type_code="10">Number Slider</item>\n                    <item name="Optional" type_name="gh_bool" type_code="1">false</item>\n                    <item name="SourceCount" type_name="gh_int32" type_code="3">0</item>\n                    <item name="InstanceGuid" type_name="gh_guid" type_code="9">bb095ede-a480-46fb-8587-9d95ded31b21</item>\n                    <item name="NickName" type_name="gh_string" type_code="10">Openings (example)</item>\n                  </items>\n                  <chunks count="2">\n                    <chunk name="Attributes">\n                      <items count="2">\n                        <item name="Pivot" type_name="gh_drawing_pointf" type_code="31">\n                          <X>140</X>\n                          <Y>220</Y>\n                        </item>\n                        <item name="Bounds" type_name="gh_drawing_rectanglef" type_code="35">\n                          <X>10.0</X>\n                          <Y>210.0</Y>\n                          <W>260</W>\n                          <H>20</H>\n                        </item>\n                      </items>\n                    </chunk>\n                    <chunk name="Slider">\n                      <items count="7">\n                        <item name="GripDisplay" type_name="gh_int32" type_code="3">1</item>\n                        <item name="SnapCount" type_name="gh_int32" type_code="3">0</item>\n                        <item name="Value" type_name="gh_double" type_code="6">6</item>\n                        <item name="Min" type_name="gh_double" type_code="6">3</item>\n                        <item name="Max" type_name="gh_double" type_code="6">30</item>\n                        <item name="Interval" type_name="gh_int32" type_code="3">1</item>\n                        <item name="Digits" type_name="gh_int32" type_code="3">0</item>\n                      </items>\n                    </chunk>\n                  </chunks>\n                </chunk>\n              </chunks>\n            </chunk>\n            <chunk name="Object" index="3">\n              <items count="2">\n                <item name="GUID" type_name="gh_guid" type_code="9">57da07bd-ecab-415d-9d86-af36d7073abc</item>\n                <item name="Name" type_name="gh_string" type_code="10">Number Slider</item>\n              </items>\n              <chunks count="1">\n                <chunk name="Container">\n                  <items count="6">\n                    <item name="Description" type_name="gh_string" type_code="10">Numeric slider for single values</item>\n                    <item name="Name" type_name="gh_string" type_code="10">Number Slider</item>\n                    <item name="Optional" type_name="gh_bool" type_code="1">false</item>\n                    <item name="SourceCount" type_name="gh_int32" type_code="3">0</item>\n                    <item name="InstanceGuid" type_name="gh_guid" type_code="9">b278264b-378b-4b09-ad96-381de877599c</item>\n                    <item name="NickName" type_name="gh_string" type_code="10">Module Height (example)</item>\n                  </items>\n                  <chunks count="2">\n                    <chunk name="Attributes">\n                      <items count="2">\n                        <item name="Pivot" type_name="gh_drawing_pointf" type_code="31">\n                          <X>140</X>\n                          <Y>260</Y>\n                        </item>\n                        <item name="Bounds" type_name="gh_drawing_rectanglef" type_code="35">\n                          <X>10.0</X>\n                          <Y>250.0</Y>\n                          <W>260</W>\n                          <H>20</H>\n                        </item>\n                      </items>\n                    </chunk>\n                    <chunk name="Slider">\n                      <items count="7">\n                        <item name="GripDisplay" type_name="gh_int32" type_code="3">1</item>\n                        <item name="SnapCount" type_name="gh_int32" type_code="3">0</item>\n                        <item name="Value" type_name="gh_double" type_code="6">30</item>\n                        <item name="Min" type_name="gh_double" type_code="6">1</item>\n                        <item name="Max" type_name="gh_double" type_code="6">200</item>\n                        <item name="Interval" type_name="gh_int32" type_code="3">0</item>\n                        <item name="Digits" type_name="gh_int32" type_code="3">2</item>\n                      </items>\n                    </chunk>\n                  </chunks>\n                </chunk>\n              </chunks>\n            </chunk>\n            <chunk name="Object" index="4">\n              <items count="2">\n                <item name="GUID" type_name="gh_guid" type_code="9">57da07bd-ecab-415d-9d86-af36d7073abc</item>\n                <item name="Name" type_name="gh_string" type_code="10">Number Slider</item>\n              </items>\n              <chunks count="1">\n                <chunk name="Container">\n                  <items count="6">\n                    <item name="Description" type_name="gh_string" type_code="10">Numeric slider for single values</item>\n                    <item name="Name" type_name="gh_string" type_code="10">Number Slider</item>\n                    <item name="Optional" type_name="gh_bool" type_code="1">false</item>\n                    <item name="SourceCount" type_name="gh_int32" type_code="3">0</item>\n                    <item name="InstanceGuid" type_name="gh_guid" type_code="9">1c957901-4164-42b7-bd79-9859c4cf1b92</item>\n                    <item name="NickName" type_name="gh_string" type_code="10">Layer 1 (example)</item>\n                  </items>\n                  <chunks count="2">\n                    <chunk name="Attributes">\n                      <items count="2">\n                        <item name="Pivot" type_name="gh_drawing_pointf" type_code="31">\n                          <X>140</X>\n                          <Y>300</Y>\n                        </item>\n                        <item name="Bounds" type_name="gh_drawing_rectanglef" type_code="35">\n                          <X>10.0</X>\n                          <Y>290.0</Y>\n                          <W>260</W>\n                          <H>20</H>\n                        </item>\n                      </items>\n                    </chunk>\n                    <chunk name="Slider">\n                      <items count="7">\n                        <item name="GripDisplay" type_name="gh_int32" type_code="3">1</item>\n                        <item name="SnapCount" type_name="gh_int32" type_code="3">0</item>\n                        <item name="Value" type_name="gh_double" type_code="6">1</item>\n                        <item name="Min" type_name="gh_double" type_code="6">0.1</item>\n                        <item name="Max" type_name="gh_double" type_code="6">10</item>\n                        <item name="Interval" type_name="gh_int32" type_code="3">0</item>\n                        <item name="Digits" type_name="gh_int32" type_code="3">2</item>\n                      </items>\n                    </chunk>\n                  </chunks>\n                </chunk>\n              </chunks>\n            </chunk>\n            <chunk name="Object" index="5">\n              <items count="2">\n                <item name="GUID" type_name="gh_guid" type_code="9">57da07bd-ecab-415d-9d86-af36d7073abc</item>\n                <item name="Name" type_name="gh_string" type_code="10">Number Slider</item>\n              </items>\n              <chunks count="1">\n                <chunk name="Container">\n                  <items count="6">\n                    <item name="Description" type_name="gh_string" type_code="10">Numeric slider for single values</item>\n                    <item name="Name" type_name="gh_string" type_code="10">Number Slider</item>\n                    <item name="Optional" type_name="gh_bool" type_code="1">false</item>\n                    <item name="SourceCount" type_name="gh_int32" type_code="3">0</item>\n                    <item name="InstanceGuid" type_name="gh_guid" type_code="9">913073c9-4d2e-45f2-9d05-5531e2908c43</item>\n                    <item name="NickName" type_name="gh_string" type_code="10">Layer 2 (example)</item>\n                  </items>\n                  <chunks count="2">\n                    <chunk name="Attributes">\n                      <items count="2">\n                        <item name="Pivot" type_name="gh_drawing_pointf" type_code="31">\n                          <X>140</X>\n                          <Y>340</Y>\n                        </item>\n                        <item name="Bounds" type_name="gh_drawing_rectanglef" type_code="35">\n                          <X>10.0</X>\n                          <Y>330.0</Y>\n                          <W>260</W>\n                          <H>20</H>\n                        </item>\n                      </items>\n                    </chunk>\n                    <chunk name="Slider">\n                      <items count="7">\n                        <item name="GripDisplay" type_name="gh_int32" type_code="3">1</item>\n                        <item name="SnapCount" type_name="gh_int32" type_code="3">0</item>\n                        <item name="Value" type_name="gh_double" type_code="6">2</item>\n                        <item name="Min" type_name="gh_double" type_code="6">0.1</item>\n                        <item name="Max" type_name="gh_double" type_code="6">10</item>\n                        <item name="Interval" type_name="gh_int32" type_code="3">0</item>\n                        <item name="Digits" type_name="gh_int32" type_code="3">2</item>\n                      </items>\n                    </chunk>\n                  </chunks>\n                </chunk>\n              </chunks>\n            </chunk>\n            <chunk name="Object" index="6">\n              <items count="2">\n                <item name="GUID" type_name="gh_guid" type_code="9">57da07bd-ecab-415d-9d86-af36d7073abc</item>\n                <item name="Name" type_name="gh_string" type_code="10">Number Slider</item>\n              </items>\n              <chunks count="1">\n                <chunk name="Container">\n                  <items count="6">\n                    <item name="Description" type_name="gh_string" type_code="10">Numeric slider for single values</item>\n                    <item name="Name" type_name="gh_string" type_code="10">Number Slider</item>\n                    <item name="Optional" type_name="gh_bool" type_code="1">false</item>\n                    <item name="SourceCount" type_name="gh_int32" type_code="3">0</item>\n                    <item name="InstanceGuid" type_name="gh_guid" type_code="9">f3a4ca31-2abd-4717-bf2b-a6f0fb62bc5f</item>\n                    <item name="NickName" type_name="gh_string" type_code="10">Layer 3 (example)</item>\n                  </items>\n                  <chunks count="2">\n                    <chunk name="Attributes">\n                      <items count="2">\n                        <item name="Pivot" type_name="gh_drawing_pointf" type_code="31">\n                          <X>140</X>\n                          <Y>380</Y>\n                        </item>\n                        <item name="Bounds" type_name="gh_drawing_rectanglef" type_code="35">\n                          <X>10.0</X>\n                          <Y>370.0</Y>\n                          <W>260</W>\n                          <H>20</H>\n                        </item>\n                      </items>\n                    </chunk>\n                    <chunk name="Slider">\n                      <items count="7">\n                        <item name="GripDisplay" type_name="gh_int32" type_code="3">1</item>\n                        <item name="SnapCount" type_name="gh_int32" type_code="3">0</item>\n                        <item name="Value" type_name="gh_double" type_code="6">3</item>\n                        <item name="Min" type_name="gh_double" type_code="6">0.1</item>\n                        <item name="Max" type_name="gh_double" type_code="6">10</item>\n                        <item name="Interval" type_name="gh_int32" type_code="3">0</item>\n                        <item name="Digits" type_name="gh_int32" type_code="3">2</item>\n                      </items>\n                    </chunk>\n                  </chunks>\n                </chunk>\n              </chunks>\n            </chunk>\n            <chunk name="Object" index="7">\n              <items count="2">\n                <item name="GUID" type_name="gh_guid" type_code="9">57da07bd-ecab-415d-9d86-af36d7073abc</item>\n                <item name="Name" type_name="gh_string" type_code="10">Number Slider</item>\n              </items>\n              <chunks count="1">\n                <chunk name="Container">\n                  <items count="6">\n                    <item name="Description" type_name="gh_string" type_code="10">Numeric slider for single values</item>\n                    <item name="Name" type_name="gh_string" type_code="10">Number Slider</item>\n                    <item name="Optional" type_name="gh_bool" type_code="1">false</item>\n                    <item name="SourceCount" type_name="gh_int32" type_code="3">0</item>\n                    <item name="InstanceGuid" type_name="gh_guid" type_code="9">5b50d893-e3d3-4a05-ad2a-117c017909b7</item>\n                    <item name="NickName" type_name="gh_string" type_code="10">Layer 4 (example)</item>\n                  </items>\n                  <chunks count="2">\n                    <chunk name="Attributes">\n                      <items count="2">\n                        <item name="Pivot" type_name="gh_drawing_pointf" type_code="31">\n                          <X>140</X>\n                          <Y>420</Y>\n                        </item>\n                        <item name="Bounds" type_name="gh_drawing_rectanglef" type_code="35">\n                          <X>10.0</X>\n                          <Y>410.0</Y>\n                          <W>260</W>\n                          <H>20</H>\n                        </item>\n                      </items>\n                    </chunk>\n                    <chunk name="Slider">\n                      <items count="7">\n                        <item name="GripDisplay" type_name="gh_int32" type_code="3">1</item>\n                        <item name="SnapCount" type_name="gh_int32" type_code="3">0</item>\n                        <item name="Value" type_name="gh_double" type_code="6">4</item>\n                        <item name="Min" type_name="gh_double" type_code="6">0.1</item>\n                        <item name="Max" type_name="gh_double" type_code="6">10</item>\n                        <item name="Interval" type_name="gh_int32" type_code="3">0</item>\n                        <item name="Digits" type_name="gh_int32" type_code="3">2</item>\n                      </items>\n                    </chunk>\n                  </chunks>\n                </chunk>\n              </chunks>\n            </chunk>\n            <chunk name="Object" index="8">\n              <items count="2">\n                <item name="GUID" type_name="gh_guid" type_code="9">f31d8d7a-7536-4ac8-9c96-fde6ecda4d0a</item>\n                <item name="Name" type_name="gh_string" type_code="10">Cluster</item>\n              </items>\n              <chunks count="1">\n                <chunk name="Container">\n                  <items count="7">\n                    <item name="ClusterDocument" type_name="gh_bytearray" type_code="20">\n                      <stream length="47772">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</stream>\n                    </item>\n                    <item name="Description" type_name="gh_string" type_code="10">Contains a cluster of Grasshopper components</item>\n                    <item name="PreviewDocument" type_name="gh_bool" type_code="1">false</item>\n                    <item name="InstanceGuid" type_name="gh_guid" type_code="9">27d79294-4817-4469-a7e7-305b0f5f0f57</item>\n                    <item name="Name" type_name="gh_string" type_code="10">Seagrass Support Generator</item>\n                    <item name="NickName" type_name="gh_string" type_code="10">Original four-layer support</item>\n                    <item name="Hidden" type_name="gh_bool" type_code="1">true</item>\n                  </items>\n                  <chunks count="3">\n                    <chunk name="ParamMap">\n                      <items count="19">\n                        <item name="Count" type_name="gh_int32" type_code="3">9</item>\n                        <item name="Key" index="0" type_name="gh_guid" type_code="9">15181b1d-ea11-44fa-ab0c-f04164cee052</item>\n                        <item name="Key" index="1" type_name="gh_guid" type_code="9">19fd5e1e-9a00-4a78-afca-421edc4b3a38</item>\n                        <item name="Key" index="2" type_name="gh_guid" type_code="9">24cf07eb-6a89-4660-8bba-03fa757e6afb</item>\n                        <item name="Key" index="3" type_name="gh_guid" type_code="9">478dd510-beb3-41a0-8fa5-467061898f69</item>\n                        <item name="Key" index="4" type_name="gh_guid" type_code="9">7345129f-ab6e-4885-81cf-dd619cb3fbb2</item>\n                        <item name="Key" index="5" type_name="gh_guid" type_code="9">af48a8e8-607c-41e5-9eb8-417935890f8e</item>\n                        <item name="Key" index="6" type_name="gh_guid" type_code="9">ba3866ce-fc1f-498d-a0ef-088be6b38413</item>\n                        <item name="Key" index="7" type_name="gh_guid" type_code="9">c58c5fef-f360-4fb1-9501-9507bd1ea959</item>\n                        <item name="Key" index="8" type_name="gh_guid" type_code="9">d0223397-ac7b-4fdf-a72e-15587e0d9b36</item>\n                        <item name="Value" index="0" type_name="gh_guid" type_code="9">a9f3eb0e-a637-4c33-b1be-ce934b817787</item>\n                        <item name="Value" index="1" type_name="gh_guid" type_code="9">41c97080-73f7-4a24-bb98-0e1f32f2f1c1</item>\n                        <item name="Value" index="2" type_name="gh_guid" type_code="9">69261494-654a-4b89-8e35-f344249ecc2f</item>\n                        <item name="Value" index="3" type_name="gh_guid" type_code="9">8664ff1d-bddf-4b9f-bc9a-34cc987a1f74</item>\n                        <item name="Value" index="4" type_name="gh_guid" type_code="9">d3e1aeb9-39af-416c-b862-991f80551c97</item>\n                        <item name="Value" index="5" type_name="gh_guid" type_code="9">c0777480-4bf5-4168-9d83-40842325e8dc</item>\n                        <item name="Value" index="6" type_name="gh_guid" type_code="9">e84c8f15-5a84-42aa-9ae8-96e6dca3c8c9</item>\n                        <item name="Value" index="7" type_name="gh_guid" type_code="9">8ea4176f-c2b9-48e9-8bf2-4c8e5678de59</item>\n                        <item name="Value" index="8" type_name="gh_guid" type_code="9">7b919b81-4920-47a4-8022-2b5258420205</item>\n                      </items>\n                    </chunk>\n                    <chunk name="Attributes">\n                      <items count="3">\n                        <item name="Selected" type_name="gh_bool" type_code="1">true</item>\n                        <item name="Pivot" type_name="gh_drawing_pointf" type_code="31">\n                          <X>440</X>\n                          <Y>280</Y>\n                        </item>\n                        <item name="Bounds" type_name="gh_drawing_rectanglef" type_code="35">\n                          <X>325.0</X>\n                          <Y>170.0</Y>\n                          <W>230</W>\n                          <H>220</H>\n                        </item>\n                      </items>\n                    </chunk>\n                    <chunk name="ParameterData">\n                      <items count="11">\n                        <item name="InputCount" type_name="gh_int32" type_code="3">8</item>\n                        <item name="InputId" index="0" type_name="gh_guid" type_code="9">b6236720-8d88-4289-93c3-ac4c99f9b97b</item>\n                        <item name="InputId" index="1" type_name="gh_guid" type_code="9">b6236720-8d88-4289-93c3-ac4c99f9b97b</item>\n                        <item name="InputId" index="2" type_name="gh_guid" type_code="9">b6236720-8d88-4289-93c3-ac4c99f9b97b</item>\n                        <item name="InputId" index="3" type_name="gh_guid" type_code="9">b6236720-8d88-4289-93c3-ac4c99f9b97b</item>\n                        <item name="InputId" index="4" type_name="gh_guid" type_code="9">b6236720-8d88-4289-93c3-ac4c99f9b97b</item>\n                        <item name="InputId" index="5" type_name="gh_guid" type_code="9">b6236720-8d88-4289-93c3-ac4c99f9b97b</item>\n                        <item name="InputId" index="6" type_name="gh_guid" type_code="9">b6236720-8d88-4289-93c3-ac4c99f9b97b</item>\n                        <item name="InputId" index="7" type_name="gh_guid" type_code="9">b6236720-8d88-4289-93c3-ac4c99f9b97b</item>\n                        <item name="OutputCount" type_name="gh_int32" type_code="3">1</item>\n                        <item name="OutputId" index="0" type_name="gh_guid" type_code="9">8ec86459-bf01-4409-baee-174d0d2b13d0</item>\n                      </items>\n                      <chunks count="9">\n                        <chunk name="InputParam" index="0">\n                          <items count="8">\n                            <item name="Access" type_name="gh_int32" type_code="3">2</item>\n                            <item name="Description" type_name="gh_string" type_code="10">A wire relay object</item>\n                            <item name="InstanceGuid" type_name="gh_guid" type_code="9">19fd5e1e-9a00-4a78-afca-421edc4b3a38</item>\n                            <item name="Name" type_name="gh_string" type_code="10">Relay</item>\n                            <item name="NickName" type_name="gh_string" type_code="10">Planting Pod Radius</item>\n                            <item name="Optional" type_name="gh_bool" type_code="1">true</item>\n                            <item name="SourceCount" type_name="gh_int32" type_code="3">1</item>\n                            <item name="Source" type_name="gh_guid" type_code="9" index="0">3fe12075-90bc-4039-8d6d-99890d90a191</item>\n                          </items>\n                          <chunks count="1">\n                            <chunk name="Attributes">\n                              <items count="3">\n                                <item name="Bounds" type_name="gh_drawing_rectanglef" type_code="35">\n                                  <X>433</X>\n                                  <Y>239</Y>\n                                  <W>132</W>\n                                  <H>20</H>\n                                </item>\n                                <item name="Pivot" type_name="gh_drawing_pointf" type_code="31">\n                                  <X>500.5</X>\n                                  <Y>249</Y>\n                                </item>\n                                <item name="Selected" type_name="gh_bool" type_code="1">true</item>\n                              </items>\n                            </chunk>\n                          </chunks>\n                        </chunk>\n                        <chunk name="InputParam" index="1">\n                          <items count="8">\n                            <item name="Access" type_name="gh_int32" type_code="3">2</item>\n                            <item name="Description" type_name="gh_string" type_code="10">A wire relay object</item>\n                            <item name="InstanceGuid" type_name="gh_guid" type_code="9">15181b1d-ea11-44fa-ab0c-f04164cee052</item>\n                            <item name="Name" type_name="gh_string" type_code="10">Relay</item>\n                            <item name="NickName" type_name="gh_string" type_code="10">Planting Pod Depth</item>\n                            <item name="Optional" type_name="gh_bool" type_code="1">true</item>\n                            <item name="SourceCount" type_name="gh_int32" type_code="3">1</item>\n                            <item name="Source" type_name="gh_guid" type_code="9" index="0">1f0c82f2-40df-4e7e-ac77-fb34c44228d1</item>\n                          </items>\n                          <chunks count="1">\n                            <chunk name="Attributes">\n                              <items count="3">\n                                <item name="Bounds" type_name="gh_drawing_rectanglef" type_code="35">\n                                  <X>433</X>\n                                  <Y>259</Y>\n                                  <W>132</W>\n                                  <H>20</H>\n                                </item>\n                                <item name="Pivot" type_name="gh_drawing_pointf" type_code="31">\n                                  <X>500.5</X>\n                                  <Y>269</Y>\n                                </item>\n                                <item name="Selected" type_name="gh_bool" type_code="1">true</item>\n                              </items>\n                            </chunk>\n                          </chunks>\n                        </chunk>\n                        <chunk name="InputParam" index="2">\n                          <items count="8">\n                            <item name="Access" type_name="gh_int32" type_code="3">2</item>\n                            <item name="Description" type_name="gh_string" type_code="10">A wire relay object</item>\n                            <item name="InstanceGuid" type_name="gh_guid" type_code="9">7345129f-ab6e-4885-81cf-dd619cb3fbb2</item>\n                            <item name="Name" type_name="gh_string" type_code="10">Relay</item>\n                            <item name="NickName" type_name="gh_string" type_code="10">Porosity</item>\n                            <item name="Optional" type_name="gh_bool" type_code="1">true</item>\n                            <item name="SourceCount" type_name="gh_int32" type_code="3">1</item>\n                            <item name="Source" type_name="gh_guid" type_code="9" index="0">bb095ede-a480-46fb-8587-9d95ded31b21</item>\n                          </items>\n                          <chunks count="1">\n                            <chunk name="Attributes">\n                              <items count="3">\n                                <item name="Bounds" type_name="gh_drawing_rectanglef" type_code="35">\n                                  <X>433</X>\n                                  <Y>279</Y>\n                                  <W>132</W>\n                                  <H>20</H>\n                                </item>\n                                <item name="Pivot" type_name="gh_drawing_pointf" type_code="31">\n                                  <X>500.5</X>\n                                  <Y>289</Y>\n                                </item>\n                                <item name="Selected" type_name="gh_bool" type_code="1">true</item>\n                              </items>\n                            </chunk>\n                          </chunks>\n                        </chunk>\n                        <chunk name="InputParam" index="3">\n                          <items count="8">\n                            <item name="Access" type_name="gh_int32" type_code="3">2</item>\n                            <item name="Description" type_name="gh_string" type_code="10">A wire relay object</item>\n                            <item name="InstanceGuid" type_name="gh_guid" type_code="9">af48a8e8-607c-41e5-9eb8-417935890f8e</item>\n                            <item name="Name" type_name="gh_string" type_code="10">Relay</item>\n                            <item name="NickName" type_name="gh_string" type_code="10">Support Module Height</item>\n                            <item name="Optional" type_name="gh_bool" type_code="1">true</item>\n                            <item name="SourceCount" type_name="gh_int32" type_code="3">1</item>\n                            <item name="Source" type_name="gh_guid" type_code="9" index="0">b278264b-378b-4b09-ad96-381de877599c</item>\n                          </items>\n                          <chunks count="1">\n                            <chunk name="Attributes">\n                              <items count="3">\n                                <item name="Bounds" type_name="gh_drawing_rectanglef" type_code="35">\n                                  <X>433</X>\n                                  <Y>299</Y>\n                                  <W>132</W>\n                                  <H>20</H>\n                                </item>\n                                <item name="Pivot" type_name="gh_drawing_pointf" type_code="31">\n                                  <X>500.5</X>\n                                  <Y>309</Y>\n                                </item>\n                                <item name="Selected" type_name="gh_bool" type_code="1">true</item>\n                              </items>\n                            </chunk>\n                          </chunks>\n                        </chunk>\n                        <chunk name="InputParam" index="4">\n                          <items count="8">\n                            <item name="Access" type_name="gh_int32" type_code="3">2</item>\n                            <item name="Description" type_name="gh_string" type_code="10">A wire relay object</item>\n                            <item name="InstanceGuid" type_name="gh_guid" type_code="9">d0223397-ac7b-4fdf-a72e-15587e0d9b36</item>\n                            <item name="Name" type_name="gh_string" type_code="10">Relay</item>\n                            <item name="NickName" type_name="gh_string" type_code="10">Anchor Depth 1</item>\n                            <item name="Optional" type_name="gh_bool" type_code="1">true</item>\n                            <item name="SourceCount" type_name="gh_int32" type_code="3">1</item>\n                            <item name="Source" type_name="gh_guid" type_code="9" index="0">1c957901-4164-42b7-bd79-9859c4cf1b92</item>\n                          </items>\n                          <chunks count="1">\n                            <chunk name="Attributes">\n                              <items count="3">\n                                <item name="Bounds" type_name="gh_drawing_rectanglef" type_code="35">\n                                  <X>433</X>\n                                  <Y>319</Y>\n                                  <W>132</W>\n                                  <H>20</H>\n                                </item>\n                                <item name="Pivot" type_name="gh_drawing_pointf" type_code="31">\n                                  <X>500.5</X>\n                                  <Y>329</Y>\n                                </item>\n                                <item name="Selected" type_name="gh_bool" type_code="1">true</item>\n                              </items>\n                            </chunk>\n                          </chunks>\n                        </chunk>\n                        <chunk name="InputParam" index="5">\n                          <items count="8">\n                            <item name="Access" type_name="gh_int32" type_code="3">2</item>\n                            <item name="Description" type_name="gh_string" type_code="10">A wire relay object</item>\n                            <item name="InstanceGuid" type_name="gh_guid" type_code="9">c58c5fef-f360-4fb1-9501-9507bd1ea959</item>\n                            <item name="Name" type_name="gh_string" type_code="10">Relay</item>\n                            <item name="NickName" type_name="gh_string" type_code="10">Anchor Depth 2</item>\n                            <item name="Optional" type_name="gh_bool" type_code="1">true</item>\n                            <item name="SourceCount" type_name="gh_int32" type_code="3">1</item>\n                            <item name="Source" type_name="gh_guid" type_code="9" index="0">913073c9-4d2e-45f2-9d05-5531e2908c43</item>\n                          </items>\n                          <chunks count="1">\n                            <chunk name="Attributes">\n                              <items count="3">\n                                <item name="Bounds" type_name="gh_drawing_rectanglef" type_code="35">\n                                  <X>433</X>\n                                  <Y>339</Y>\n                                  <W>132</W>\n                                  <H>20</H>\n                                </item>\n                                <item name="Pivot" type_name="gh_drawing_pointf" type_code="31">\n                                  <X>500.5</X>\n                                  <Y>349</Y>\n                                </item>\n                                <item name="Selected" type_name="gh_bool" type_code="1">true</item>\n                              </items>\n                            </chunk>\n                          </chunks>\n                        </chunk>\n                        <chunk name="InputParam" index="6">\n                          <items count="8">\n                            <item name="Access" type_name="gh_int32" type_code="3">2</item>\n                            <item name="Description" type_name="gh_string" type_code="10">A wire relay object</item>\n                            <item name="InstanceGuid" type_name="gh_guid" type_code="9">ba3866ce-fc1f-498d-a0ef-088be6b38413</item>\n                            <item name="Name" type_name="gh_string" type_code="10">Relay</item>\n                            <item name="NickName" type_name="gh_string" type_code="10">Anchor Depth 3</item>\n                            <item name="Optional" type_name="gh_bool" type_code="1">true</item>\n                            <item name="SourceCount" type_name="gh_int32" type_code="3">1</item>\n                            <item name="Source" type_name="gh_guid" type_code="9" index="0">f3a4ca31-2abd-4717-bf2b-a6f0fb62bc5f</item>\n                          </items>\n                          <chunks count="1">\n                            <chunk name="Attributes">\n                              <items count="3">\n                                <item name="Bounds" type_name="gh_drawing_rectanglef" type_code="35">\n                                  <X>433</X>\n                                  <Y>359</Y>\n                                  <W>132</W>\n                                  <H>20</H>\n                                </item>\n                                <item name="Pivot" type_name="gh_drawing_pointf" type_code="31">\n                                  <X>500.5</X>\n                                  <Y>369</Y>\n                                </item>\n                                <item name="Selected" type_name="gh_bool" type_code="1">true</item>\n                              </items>\n                            </chunk>\n                          </chunks>\n                        </chunk>\n                        <chunk name="InputParam" index="7">\n                          <items count="8">\n                            <item name="Access" type_name="gh_int32" type_code="3">2</item>\n                            <item name="Description" type_name="gh_string" type_code="10">A wire relay object</item>\n                            <item name="InstanceGuid" type_name="gh_guid" type_code="9">24cf07eb-6a89-4660-8bba-03fa757e6afb</item>\n                            <item name="Name" type_name="gh_string" type_code="10">Relay</item>\n                            <item name="NickName" type_name="gh_string" type_code="10">Anchor Depth 4</item>\n                            <item name="Optional" type_name="gh_bool" type_code="1">true</item>\n                            <item name="SourceCount" type_name="gh_int32" type_code="3">1</item>\n                            <item name="Source" type_name="gh_guid" type_code="9" index="0">5b50d893-e3d3-4a05-ad2a-117c017909b7</item>\n                          </items>\n                          <chunks count="1">\n                            <chunk name="Attributes">\n                              <items count="3">\n                                <item name="Bounds" type_name="gh_drawing_rectanglef" type_code="35">\n                                  <X>433</X>\n                                  <Y>379</Y>\n                                  <W>132</W>\n                                  <H>20</H>\n                                </item>\n                                <item name="Pivot" type_name="gh_drawing_pointf" type_code="31">\n                                  <X>500.5</X>\n                                  <Y>389</Y>\n                                </item>\n                                <item name="Selected" type_name="gh_bool" type_code="1">true</item>\n                              </items>\n                            </chunk>\n                          </chunks>\n                        </chunk>\n                        <chunk name="OutputParam" index="0">\n                          <items count="7">\n                            <item name="Access" type_name="gh_int32" type_code="3">2</item>\n                            <item name="Description" type_name="gh_string" type_code="10">Result of merge</item>\n                            <item name="InstanceGuid" type_name="gh_guid" type_code="9">478dd510-beb3-41a0-8fa5-467061898f69</item>\n                            <item name="Name" type_name="gh_string" type_code="10">Result</item>\n                            <item name="NickName" type_name="gh_string" type_code="10">Geometry</item>\n                            <item name="Optional" type_name="gh_bool" type_code="1">false</item>\n                            <item name="SourceCount" type_name="gh_int32" type_code="3">0</item>\n                          </items>\n                          <chunks count="1">\n                            <chunk name="Attributes">\n                              <items count="3">\n                                <item name="Bounds" type_name="gh_drawing_rectanglef" type_code="35">\n                                  <X>595</X>\n                                  <Y>239</Y>\n                                  <W>62</W>\n                                  <H>160</H>\n                                </item>\n                                <item name="Pivot" type_name="gh_drawing_pointf" type_code="31">\n                                  <X>626</X>\n                                  <Y>319</Y>\n                                </item>\n                                <item name="Selected" type_name="gh_bool" type_code="1">true</item>\n                              </items>\n                            </chunk>\n                          </chunks>\n                        </chunk>\n                      </chunks>\n                    </chunk>\n                  </chunks>\n                </chunk>\n              </chunks>\n            </chunk>\n            </chunks>\n        </chunk>\n      </chunks>\n    </chunk>\n  </chunks>\n</Archive>'
SLIDER_IDS=['3fe12075-90bc-4039-8d6d-99890d90a191', '1f0c82f2-40df-4e7e-ac77-fb34c44228d1', 'bb095ede-a480-46fb-8587-9d95ded31b21', 'b278264b-378b-4b09-ad96-381de877599c', '1c957901-4164-42b7-bd79-9859c4cf1b92', '913073c9-4d2e-45f2-9d05-5531e2908c43', 'f3a4ca31-2abd-4717-bf2b-a6f0fb62bc5f', '5b50d893-e3d3-4a05-ad2a-117c017909b7']
# Python 2.7 / 3 compatible; embedded in the Grasshopper document.
import hashlib
import csv

FIELDS = ['Radius','Depth','Openings','Height','Layer1','Layer2','Layer3','Layer4','Yaw','OffsetX','OffsetY','Gap','Enabled']

def support_id(mode, x, y, yaw):
    key = '%d|%.6f|%.6f|%.6f' % (mode,x,y,yaw)
    return 'S-' + hashlib.sha256(key.encode('ascii')).hexdigest()[:12]

def read_overrides(lines):
    result = {}
    for block in lines or []:
        for line in str(block).splitlines():
            if not line.strip() or line.lstrip().startswith('#'): continue
            cells = next(csv.reader([line]))
            cells = [v.strip() for v in cells]
            if cells[0].lower() == 'id': continue
            if len(cells)==15: cells=cells[:14]
            if len(cells) != 14: raise ValueError('Each override row needs ID + 13 fields; blank means default.')
            ident = cells[0]
            if not ident.startswith('S-'): raise ValueError('Copy an ID from the Catalog output: '+ident)
            if ident in result: raise ValueError('Duplicate support ID: '+ident)
            values = [None if not s else float(s) for s in cells[1:]]
            if any(v is not None and (math.isnan(v) or math.isinf(v)) for v in values): raise ValueError('Non-finite parameter: '+ident)
            result[ident] = values
    return result

def resolve_params(defaults, override):
    values = list(defaults)
    if override:
        values = [a if b is None else b for a,b in zip(values,override)]
    if any(v <= 0 for v in values[:8]): raise ValueError('All eight generator parameters must be positive')
    bounds=[(1,100),(0.5,100),(3,30),(1,200)]+[(0.1,10)]*4
    if any(not lo<=v<=hi for v,(lo,hi) in zip(values[:8],bounds)): raise ValueError('Generator parameter outside original slider range')
    if values[2] != int(values[2]) or not 3 <= values[2] <= 30: raise ValueError('Openings must be an integer from 3 to 30')
    if values[11] < 0: raise ValueError('Gap must be nonnegative')
    if values[12] not in (0,1): raise ValueError('Enabled must be 0 or 1')
    return values

def rectangles_overlap(a,b):
    # Separating axis test for two rotated padded rectangles.
    for poly in (a,b):
        for i in (0,1):
            vx=poly[i+1].X-poly[i].X; vy=poly[i+1].Y-poly[i].Y
            pa=[-vy*p.X+vx*p.Y for p in a[:4]]
            pb=[-vy*p.X+vx*p.Y for p in b[:4]]
            if max(pa)<=min(pb)+1e-8 or max(pb)<=min(pa)+1e-8: return False
    return True

def create_generator():
    import Grasshopper as GH
    import clr
    clr.AddReference('GH_IO')
    import GH_IO
    from System import Decimal
    archive=GH_IO.Serialization.GH_Archive()
    if not archive.Deserialize_Xml(SUPPORT_XML): raise ValueError('Embedded generator archive failed to load')
    document=GH.Kernel.GH_Document()
    if not archive.ExtractObject(document,'Definition'): raise ValueError('Embedded generator extraction failed')
    document.Enabled=True
    sliders={str(o.InstanceGuid):o for o in document.Objects if isinstance(o,GH.Kernel.Special.GH_NumberSlider)}
    cluster=next(o for o in document.Objects if isinstance(o,GH.Kernel.Special.GH_Cluster))
    cache={}
    def geometry(values):
        key=tuple(values[:8])
        if key in cache: return cache[key]
        for ident,v in zip(SLIDER_IDS,key): sliders[ident].SetSliderValue(Decimal(v))
        document.NewSolution(True)
        errors=list(cluster.RuntimeMessages(GH.Kernel.GH_RuntimeMessageLevel.Error))
        if errors: raise ValueError('Original generator error: '+'; '.join(str(e) for e in errors))
        output=[]
        for goo in cluster.Params.Output[0].VolatileData.AllData(True):
            g=unwrap(goo)
            if isinstance(g,rg.GeometryBase):
                if not g.IsValid: raise ValueError('Original generator produced invalid geometry')
                output.append(g.Duplicate())
        if not output: raise ValueError('Original support generator returned no geometry for '+str(key))
        cache[key]=output
        return output
    return document,geometry

# -*- coding: utf-8 -*-
# The build tool embeds layout_math.py above this code.
import Rhino.Geometry as rg
import rhinoscriptsyntax as rs
from Grasshopper import DataTree
from Grasshopper.Kernel.Data import GH_Path
from Grasshopper.Kernel import GH_RuntimeMessageLevel
from System import Object

Placed=DataTree[Object]()
Centers=[]; Frames=[]; Relief=[]; Rejected=[]; Report=''
IDs=[]; Labels=[]; Catalog=[]
generator_doc=None
def unwrap(g):
    if hasattr(g,'ScriptVariable'): g=g.ScriptVariable()
    if isinstance(g,rg.GeometryBase): return g
    return rs.coercegeometry(g)
def execute_layout():
    global Report, generator_doc
    mesh=unwrap(T)
    if not isinstance(mesh,rg.Mesh): raise ValueError('T must be a terrain mesh; use Mesh Brep for surfaces.')
    if not mesh.IsValid: raise ValueError('Terrain mesh is invalid')
    geo=[unwrap(g) for g in G]
    geo=[g for g in geo if g is not None]
    if not geo: raise ValueError('Connect the support Result output to G')
    mode=int(Mode); dx=float(DX); dy=float(DY); gap=float(Gap)
    maxrelief=float(MaxRelief); step=float(ContourStep); limit=int(MaxCount)
    margin=float(Margin); shift=float(Shift); angle=math.radians(float(Angle))
    if mode not in [0,1,2,3]: raise ValueError('Mode must be 0, 1, 2 or 3')
    if min(dx,dy,step,limit)<=0 or min(gap,margin,maxrelief)<0 or not 0<=shift<=1:
        raise ValueError('Check positive spacings/count and nonnegative clearances; Shift must be 0..1')
    bb=rg.BoundingBox.Empty
    for g in geo: bb.Union(g.GetBoundingBox(True))
    src=rg.Point3d(bb.Center.X,bb.Center.Y,bb.Min.Z)
    hx=(bb.Max.X-bb.Min.X)/2+margin; hy=(bb.Max.Y-bb.Min.Y)/2+margin
    if min(hx,hy)<=0: raise ValueError('Support must have a nonzero XY footprint')
    radius=math.sqrt(hx*hx+hy*hy)
    vertices=[(float(p.X),float(p.Y),float(p.Z)) for p in mesh.Vertices]
    triangles=[]
    for f in mesh.Faces:
        triangles.append([vertices[f.A],vertices[f.B],vertices[f.C]])
        if f.IsQuad: triangles.append([vertices[f.A],vertices[f.C],vertices[f.D]])
    if not triangles: raise ValueError('Empty terrain')
    idx=TerrainIndex(triangles,max(dx,dy,2*radius))
    boundary=unwrap(Boundary) if Boundary is not None else None
    if boundary is not None:
        if not isinstance(boundary,rg.Curve) or not boundary.IsClosed: raise ValueError('Boundary must be a closed curve')
        boundary=rg.Curve.ProjectToPlane(boundary,rg.Plane.WorldXY)
    candidates=[]; contour_curves=[]
    fallback=False
    if mode==0:
        tb=mesh.GetBoundingBox(True)
        n=int(math.floor((tb.Max.Z-tb.Min.Z)/step))
        if n>500: raise ValueError('More than 500 contours: increase ContourStep')
        for k in range(1,n+1):
            plane=rg.Plane(rg.Point3d(0,0,tb.Min.Z+k*step),rg.Vector3d.ZAxis)
            curves=rg.Mesh.CreateContourCurves(mesh,plane)
            for curve in curves:
                contour_curves.append(curve)
                ts=curve.DivideByLength(dx,True)
                if ts is None: ts=[curve.Domain.Mid]
                for j,t in enumerate(ts):
                    p=curve.PointAt(t); v=curve.TangentAt(t)
                    candidates.append((p.X,p.Y,math.atan2(v.Y,v.X),k,j))
                    if len(candidates)>20000: raise ValueError('More than 20000 contour candidates')
    if mode in [1,2]:
        candidates=list(grid_candidates((idx.x0,idx.y0,idx.x1,idx.y1),dx,dy,angle,shift if mode==2 else 0))
    if mode==3:
        guide=unwrap(Guide) if Guide is not None else None
        if not isinstance(guide,rg.Curve):
            raise ValueError('Mode 3: draw/reference the gully centerline in Guide (Curve).')
        guide=rg.Curve.ProjectToPlane(guide,rg.Plane.WorldXY)
        if guide is None or not guide.IsValid or guide.GetLength()<0.001:
            raise ValueError('Guide must have a valid nonzero XY projection')
        if guide.GetLength()/dx>19999: raise ValueError('More than 20000 guide candidates: increase DX')
        ts=guide.DivideByLength(dx,True)
        if ts is None: ts=[guide.Domain.Mid]
        for j,t in enumerate(ts):
            p=guide.PointAt(t); v=guide.TangentAt(t)
            candidates.append((p.X,p.Y,math.atan2(v.Y,v.X),0,j))
    accepted=[]; footprints=[]; reasons={}; examined=0; truncated=False
    overrides=read_overrides(Overrides)
    known=set(); Catalog.append('ID,Radius,Depth,Openings,Height,Layer1,Layer2,Layer3,Layer4,Yaw,OffsetX,OffsetY,Gap,Enabled,Status')
    defaults=[float(v) for v in [DefaultRadius,DefaultDepth,DefaultOpenings,DefaultHeight,DefaultLayer1,DefaultLayer2,DefaultLayer3,DefaultLayer4]]+[0,0,0,gap,1]
    resolve_params(defaults,None)
    generator_doc,generate=create_generator()
    for x,y,yaw,row,col in candidates:
        if len(accepted)>=limit: truncated=True; break
        examined+=1
        ident=support_id(mode,x,y,yaw); known.add(ident)
        values=resolve_params(defaults,overrides.get(ident))
        rowtext=ident+','+','.join(str(v) for v in values)
        if not values[12]:
            Catalog.append(rowtext+',disabled'); continue
        x+=values[9]; y+=values[10]; yaw+=math.radians(values[8]); gap=values[11]
        geo=generate(values)
        bb=rg.BoundingBox.Empty
        for g in geo: bb.Union(g.GetBoundingBox(True))
        src=rg.Point3d(bb.Center.X,bb.Center.Y,bb.Min.Z)
        hx=(bb.Max.X-bb.Min.X)/2+margin; hy=(bb.Max.Y-bb.Min.Y)/2+margin
        if min(hx,hy)<=0: raise ValueError('Invalid support footprint: '+ident)
        radius=math.sqrt(hx*hx+hy*hy)
        reason=None
        co,si=math.cos(yaw),math.sin(yaw)
        footprint=[rg.Point3d(x+co*u-si*v,y+si*u+co*v,0) for u,v in [(-hx,-hy),(hx,-hy),(hx,hy),(-hx,hy),(-hx,-hy)]]
        if boundary:
            if any(boundary.Contains(p,rg.Plane.WorldXY,0.001)==rg.PointContainment.Outside for p in footprint[:-1]): reason='boundary'
            if reason is None:
                events=rg.Intersect.Intersection.CurveCurve(boundary,rg.PolylineCurve(footprint),0.001,0.001)
                if events and events.Count: reason='boundary'
        if reason is None and any(rectangles_overlap(footprint,f) for f in footprints): reason='overlap'
        if reason is None and mode==0 and any((x-a[0])**2+(y-a[1])**2 < dy**2 for a in accepted): reason='spacing'
        hit=idx.footprint(x,y,yaw,hx,hy) if reason is None else None
        if reason is None and hit is None: reason='terrain edge or hole'
        if reason is None and hit[1]>maxrelief: reason='relief limit'
        if reason:
            Catalog.append(rowtext+',rejected: '+reason)
            reasons[reason]=reasons.get(reason,0)+1
            h=idx.height(x,y)
            Rejected.append(rg.Point3d(x,y,h if h is not None else mesh.GetBoundingBox(True).Min.Z))
            continue
        target=rg.Point3d(x,y,hit[0]+gap)
        plane=rg.Plane(target,rg.Vector3d(co,si,0),rg.Vector3d(-si,co,0))
        transform=rg.Transform.PlaneToPlane(rg.Plane(src,rg.Vector3d.ZAxis),plane)
        path=GH_Path(len(accepted))
        for g in geo:
            copy=g.Duplicate()
            if not copy.Transform(transform): raise ValueError('Geometry transform failed')
            Placed.Add(copy,path)
        footprints.append(footprint); IDs.append(ident)
        Labels.append(rg.TextDot(ident,target)); Catalog.append(rowtext+',accepted')
        Centers.append(target); Frames.append(plane); Relief.append(hit[1]); accepted.append((x,y))
    Report=('Units: cm | Mode: {0} | Accepted: {1} | Examined: {2}/{3}\n'
            'Rejected: {4}\nAll layers horizontal; four layer parameters remain user-controlled.\n'
            'Base = source bounding-box minimum Z; highest terrain in footprint + Gap.\n'
            'Terrain coverage sampled 7x7; relief is a sampled estimate. Inspect narrow holes.\n'
            'No per-layer deformation, burial, or structural validation.').format(mode,len(accepted),examined,len(candidates),reasons)
    unused=set(overrides)-known
    if unused: Report+='\nUnused override IDs (layout changed or MaxCount reached): '+', '.join(sorted(unused))
    Report+='\nPer-support overrides active; original eight generator parameters preserved. Units: cm. Padded rectangle overlap checks.'
    if fallback: Report+='\nNo contours at this interval: used aligned grid.'
    if mode==0:
        Report+='\nFull terrain contours restored: no depression filter. No grid fallback.'
    if mode==3:
        Report+='\nGully guide: centers follow the supplied XY curve; DX is along-curve spacing. Heights come from terrain, not guide Z. Large footprints can bridge gully banks; narrow/steep sites can be rejected.'
    if truncated: Report+='\nMaxCount reached: output truncated; increase MaxCount for the full layout.'
    if not accepted: ghenv.Component.AddRuntimeMessage(GH_RuntimeMessageLevel.Warning,'No accepted modules; see Report and relax limits.')
try:
    execute_layout()
except Exception as ex:
    Placed=DataTree[Object](); Centers=[]; Frames=[]; Relief=[]; Rejected=[]
    IDs=[]; Labels=[]; Catalog=[]
    Report='ERROR: '+str(ex)
    ghenv.Component.AddRuntimeMessage(GH_RuntimeMessageLevel.Error,Report)

finally:
    if generator_doc is not None: generator_doc.Dispose()
# ---------- end individual_support_terrain_layout_v4 ----------
panel_2 = Panel(individual_support_terrain_layout_v4.Catalog)
panel_3 = Panel(individual_support_terrain_layout_v4.Report)

# ==== cluster SeagrassSupportGenerator
relay = ClusterInput()
relay_2 = ClusterInput()
relay_3 = ClusterInput()
relay_4 = ClusterInput()
relay_5 = ClusterInput()
relay_6 = ClusterInput()
relay_7 = ClusterInput()
relay_8 = ClusterInput()
cluster = Cluster(
    count_3=relay_3,
    radius=relay,
    A_2=relay_4,
    B_2=relay_2,
    value=relay_4,
    count_2=relay_3,
    count_7=relay_3,
    A_3=relay_4,
    B_3=relay_5,
    count=relay_3,
    A_6=relay_4,
    A=relay_5,
    B=relay_6,
    count_6=relay_3,
    A_7=relay_4,
    A_4=relay_5,
    B_4=relay_7,
    count_4=relay_3,
    A_8=relay_4,
    A_5=relay_5,
    B_5=relay_8,
    count_5=relay_3)
result = ClusterOutput(cluster)

# ==== cluster Cluster
A = ClusterInput()
B = ClusterInput()
A_2 = ClusterInput()
B_2 = ClusterInput()
point = Point(Point(0, 0, 0))
A_3 = ClusterInput()
B_3 = ClusterInput()
multiplication = Multiplication(A=A, B=B)
negative = Negative(Value=Slider(0.4, range=0..1))
A_4 = ClusterInput()
B_4 = ClusterInput()
addition = Addition(A=A_2, B=B_2)
radius = ClusterInput()
A_5 = ClusterInput()
B_5 = ClusterInput()
A_6 = ClusterInput()
addition_2 = Addition(A=A_3, B=B_3)
number_slider = Slider(3.3, range=0..10)
multiplication_2 = Multiplication(A=A_4, B=B_4)
circle = Circle(Plane=PlaneXY(0, 0, 0), Radius=radius)
multiplication_3 = Multiplication(A=A_5, B=B_5)
offset_curve = OffsetCurve(Curve=circle, Distance=negative, Corners=1)
addition_3 = Addition(A=A_6, B=multiplication)
negative_2 = Negative(Value=addition)
value = ClusterInput()
A_7 = ClusterInput()
A_8 = ClusterInput()
negative_3 = Negative(Value=value)
addition_4 = Addition(A=A_7, B=multiplication_2)
merge = Merge(Data1=offset_curve, Data2=circle)
addition_5 = Addition(A=A_8, B=multiplication_3)
offset_curve_2 = OffsetCurve(Curve=circle, Distance=expr("x/2", number_slider), Corners=1)
negative_4 = Negative(Value=Slider(1.423, range=0..10))
offset_curve_3 = OffsetCurve(Curve=circle, Distance=number_slider, Corners=1)
unit_z = UnitZ(Factor=negative_2)
boundary_surfaces = BoundarySurfaces(Edges=flatten(merge))
unit_z_2 = UnitZ(Factor=negative_3)
amplitude = Amplitude(Vector=unit_z_2, Amplitude=addition_2)
amplitude_2 = Amplitude(Vector=unit_z_2, Amplitude=addition_3)
amplitude_3 = Amplitude(Vector=unit_z_2, Amplitude=addition_4)
amplitude_4 = Amplitude(Vector=unit_z_2, Amplitude=addition_5)
number_slider_2 = Slider(0.635, range=0..10)
number_slider_3 = Slider(0.6, range=0..1)
number_slider_4 = Slider(1.724, range=0..10)
merge_2 = Merge(Data1=offset_curve_3, Data2=circle)
unit_z_3 = UnitZ(Factor=number_slider_4)
number_slider_5 = Slider(6, range=0..10)
unit_z_4 = UnitZ(Factor=expr("x/2", number_slider_4))
unit_z_5 = UnitZ(Factor=expr("x/2", number_slider_4))
boundary_surfaces_2 = BoundarySurfaces(Edges=flatten(merge_2))
number_slider_6 = Slider(6, range=0..10)
unit_z_6 = UnitZ(Factor=number_slider_4)
count = ClusterInput()
count_2 = ClusterInput()
count_3 = ClusterInput()
count_4 = ClusterInput()
count_5 = ClusterInput()
count_6 = ClusterInput()
number_slider_7 = Slider(1, range=0..1)
negative_5 = Negative(Value=number_slider_4)
number_slider_8 = Slider(0.2, range=0..1)
polygon = Polygon(Plane=PlaneXY(0, 0, 0), Radius=Slider(18.6, range=0..100), Segments=number_slider_6, FilletRadius=number_slider_8)  # -> Polygon, Length
polygon_2 = Polygon(Plane=PlaneXY(0, 0, 0), Radius=Slider(16, range=0..100), Segments=number_slider_6, FilletRadius=number_slider_8)  # -> Polygon, Length
polygon_3 = Polygon(Plane=PlaneXY(0, 0, 0), Radius=Slider(12, range=0..100), Segments=number_slider_6, FilletRadius=number_slider_8)  # -> Polygon, Length
polygon_4 = Polygon(Plane=PlaneXY(0, 0, 0), Radius=Slider(6.6, range=0..100), Segments=number_slider_6, FilletRadius=number_slider_8)  # -> Polygon, Length
move = Move(Geometry=polygon.Polygon, Motion=amplitude)  # -> Geometry, Transform
move_2 = Move(Geometry=polygon_2.Polygon, Motion=amplitude_2)  # -> Geometry, Transform
offset_curve_4 = OffsetCurve(Curve=move.Geometry, Distance=expr("x/2", number_slider), Corners=1)
move_3 = Move(Geometry=polygon_3.Polygon, Motion=amplitude_3)  # -> Geometry, Transform
offset_curve_5 = OffsetCurve(Curve=move_3.Geometry, Distance=expr("x/2", number_slider), Corners=1)
move_4 = Move(Geometry=polygon_4.Polygon, Motion=amplitude_4)  # -> Geometry, Transform
offset_curve_6 = OffsetCurve(Curve=move_4.Geometry, Distance=expr("x/2", number_slider), Corners=1)
offset_curve_7 = OffsetCurve(Curve=move.Geometry, Distance=number_slider, Corners=1)
offset_curve_8 = OffsetCurve(Curve=move_2.Geometry, Distance=expr("x/2", number_slider), Corners=1)
polygon_5 = Polygon(Plane=PlaneXY(0, 0, 0), Radius=Slider(22, range=0..100), Segments=number_slider_6, FilletRadius=number_slider_8)  # -> Polygon, Length
offset_curve_9 = OffsetCurve(Curve=move_2.Geometry, Distance=number_slider, Corners=1)
move_5 = Move(Geometry=offset_curve_5, Motion=unit_z_4)  # -> Geometry, Transform
move_6 = Move(Geometry=offset_curve_6, Motion=unit_z_5)  # -> Geometry, Transform
boundary_surfaces_3 = BoundarySurfaces(Edges=move_4.Geometry)
offset_curve_10 = OffsetCurve(Curve=move_3.Geometry, Distance=number_slider, Corners=1)
offset_curve_11 = OffsetCurve(Curve=move_4.Geometry, Distance=number_slider, Corners=1)
merge_3 = Merge(Data1=move.Geometry, Data2=offset_curve_7)
divide_curve = DivideCurve(Curve=offset_curve_4, Count=count, Kinks=False)  # -> Points, Tangents, Parameters
move_7 = Move(Geometry=polygon_5.Polygon, Motion=unit_z_2)  # -> Geometry, Transform
merge_4 = Merge(Data1=move_2.Geometry, Data2=offset_curve_9)
divide_curve_2 = DivideCurve(Curve=move_5.Geometry, Count=count_4, Kinks=False)  # -> Points, Tangents, Parameters
divide_curve_3 = DivideCurve(Curve=move_6.Geometry, Count=count_5, Kinks=False)  # -> Points, Tangents, Parameters
divide_curve_4 = DivideCurve(Curve=offset_curve_8, Count=count_6, Kinks=False)  # -> Points, Tangents, Parameters
boundary_surfaces_4 = BoundarySurfaces(Edges=flatten(merge_3))
unit_z_7 = UnitZ(Factor=expr("x*2", negative_5))
merge_5 = Merge(Data1=move_3.Geometry, Data2=offset_curve_10)
boundary_surfaces_5 = BoundarySurfaces(Edges=flatten(merge_4))
offset_curve_12 = OffsetCurve(Curve=move_7.Geometry, Distance=expr("x/2", number_slider), Corners=1)
merge_6 = Merge(Data1=move_4.Geometry, Data2=offset_curve_11)
move_8 = Move(Geometry=offset_curve_3, Motion=expr("x/2", unit_z_3))  # -> Geometry, Transform
divide_curve_5 = DivideCurve(Curve=move_8.Geometry, Count=count_3, Kinks=False)  # -> Points, Tangents, Parameters
line = Line(StartPoint=graft(divide_curve_5.Points), EndPoint=point)
point_2 = Point(graft(divide_curve_5.Points))
offset_curve_13 = OffsetCurve(Curve=move_7.Geometry, Distance=expr("x*1.5", number_slider), Corners=1)
merge_7 = Merge(Data1=offset_curve_13, Data2=move_7.Geometry)
boundary_surfaces_6 = BoundarySurfaces(Edges=flatten(merge_5))
boundary_surfaces_7 = BoundarySurfaces(Edges=flatten(merge_6))
number_slider_9 = Slider(0.05, range=0..0.1)
count_7 = ClusterInput()
divide_curve_6 = DivideCurve(Curve=offset_curve_12, Count=count_7, Kinks=False)  # -> Points, Tangents, Parameters
line_2 = Line(StartPoint=divide_curve.Points, EndPoint=divide_curve_4.Points)  # -> graft(Line)
unit_z_8 = UnitZ(Factor=expr("x*2", unit_z_6))
boundary_surfaces_8 = BoundarySurfaces(Edges=flatten(merge_7))
line_3 = Line(StartPoint=divide_curve_4.Points, EndPoint=divide_curve_2.Points)  # -> graft(Line)
line_4 = Line(StartPoint=divide_curve_2.Points, EndPoint=divide_curve_3.Points)  # -> graft(Line)
move_9 = Move(Geometry=divide_curve_6.Points, Motion=unit_z_4)  # -> Geometry, Transform
line_5 = Line(StartPoint=move_9.Geometry, EndPoint=divide_curve.Points)  # -> graft(Line)
circle_2 = Circle(Plane=divide_curve_6.Points, Radius=expr("x/2", number_slider))
number_slider_10 = Slider(6, range=0..10)
number_slider_11 = Slider(1, range=0..1)
move_10 = Move(Geometry=circle_2, Motion=unit_z_8)  # -> graft(Geometry), Transform
area = Area(Geometry=move_10.Geometry)  # -> Area, Centroid
line_6 = Line(StartPoint=graft(divide_curve_5.Points), EndPoint=area.Centroid)
evaluate_curve = EvaluateCurve(Curve=line_6, Parameter=Slider(0.5, range=0..1))  # -> Point, Tangent, Angle
plane_3pt = Plane3Pt(PointA=divide_curve_5.Points, PointB=flatten(area.Centroid), PointC=point)
rotate = Rotate(Geometry=flatten(line_6), Angle=1.570796327, Plane=plane_3pt)  # -> graft(Geometry), Transform
point_3 = Point(area.Centroid)
end_points = EndPoints(Curve=rotate.Geometry)  # -> Start, End
vector_2pt = Vector2Pt(PointA=end_points.Start, PointB=end_points.End, Unitize=True)  # -> Vector, Length
multiplication_4 = Multiplication(A=vector_2pt.Vector, B=negative_4)
move_11 = Move(Geometry=evaluate_curve.Point, Motion=multiplication_4)  # -> Geometry, Transform
data = Data([point_2, move_11.Geometry, point_3])
interpolate_t = InterpolateT(Vertices=data, TangentStart=Vector(0, 0, 0), TangentEnd=Vector(0, 0, 0), KnotStyle=1)  # -> Curve, Length, Domain
extend_curve = ExtendCurve(Curve=interpolate_t.Curve, Type=Slider(1, range=0..10), Start=number_slider_2, End=number_slider_2)
divide_curve_7 = DivideCurve(Curve=interpolate_t.Curve, Count=expr("x/4", count_2), Kinks=False)  # -> Points, Tangents, Parameters
flip_matrix = FlipMatrix(Data=divide_curve_7.Points)
perp_frame = PerpFrame(Curve=reparameterize(extend_curve), Parameter=Slider(0, range=0..100))
polygon_6 = Polygon(Plane=perp_frame, Radius=number_slider_3, Segments=number_slider_5, FilletRadius=number_slider_9)  # -> Polygon, Length
split_tree = SplitTree(Data=flip_matrix, Masks=flatten("{0;0;0;0;0}"))  # -> Positive, Negative
path_mapper = PathMapper(split_tree.Negative, source="{A;B;C;D;E}", target="{A;B;C;path_count-D;E}")
split_tree_2 = SplitTree(Data=path_mapper, Masks=flatten("{0;0;0;0;0}"))  # -> Positive, Negative
point_4 = Point(simplify(graft(split_tree_2.Negative)))
data_2 = Data(point_4)
path_mapper_2 = PathMapper(data_2, source="{A;B}", target="{A}")
point_5 = Point(graft(path_mapper_2))
path_mapper_3 = PathMapper(path_mapper_2, source="{A}(i)", target="{A}((i+1)%item_count)")
point_6 = Point(graft(path_mapper_3))
merge_8 = Merge(Data1=point_6, Data2=point_5)
polyline = PolyLine(Vertices=merge_8, Closed=False)
perp_frame_2 = PerpFrame(Curve=polyline, Parameter=Slider(0, range=0..100))
polygon_7 = Polygon(Plane=perp_frame_2, Radius=number_slider_3, Segments=number_slider_5, FilletRadius=number_slider_9)  # -> Polygon, Length
polygon_8 = Polygon(Plane=divide_curve_4.Points, Radius=number_slider_11, Segments=number_slider_10, FilletRadius=0)  # -> graft(Polygon), Length
polygon_9 = Polygon(Plane=move_9.Geometry, Radius=number_slider_11, Segments=number_slider_10, FilletRadius=0)  # -> graft(Polygon), Length
polygon_10 = Polygon(Plane=divide_curve.Points, Radius=number_slider_11, Segments=number_slider_10, FilletRadius=0)  # -> graft(Polygon), Length
polygon_11 = Polygon(Plane=divide_curve_2.Points, Radius=number_slider_11, Segments=number_slider_10, FilletRadius=0)  # -> graft(Polygon), Length

sweep1 = Sweep1(Rail=line_5, Sections=polygon_9.Polygon, Miter=1)
sweep1_2 = Sweep1(Rail=extend_curve, Sections=polygon_6.Polygon, Miter=1)
extrude = Extrude(Base=boundary_surfaces_2, Direction=unit_z_6)
sweep1_3 = Sweep1(Rail=polyline, Sections=polygon_7.Polygon, Miter=1)
extrude_2 = Extrude(Base=boundary_surfaces_8, Direction=unit_z_8)
extrude_3 = Extrude(Base=boundary_surfaces, Direction=unit_z)
sweep1_4 = Sweep1(Rail=line_2, Sections=polygon_10.Polygon, Miter=1)
extrude_4 = Extrude(Base=boundary_surfaces_8, Direction=unit_z_7)
sweep1_5 = Sweep1(Rail=line_4, Sections=polygon_11.Polygon, Miter=1)
extrude_5 = Extrude(Base=boundary_surfaces_6, Direction=unit_z_6)
extrude_6 = Extrude(Base=boundary_surfaces_4, Direction=unit_z_6)
sweep1_6 = Sweep1(Rail=line_3, Sections=polygon_8.Polygon, Miter=1)
extrude_7 = Extrude(Base=boundary_surfaces_7, Direction=unit_z_6)
extrude_8 = Extrude(Base=boundary_surfaces_5, Direction=unit_z_6)
extrude_9 = Extrude(Base=boundary_surfaces_3, Direction=unit_z_6)

merge_9 = Merge(
    Data1=extrude_4,
    Data2=extrude_2,
    Data3=sweep1_3,
    Data4=sweep1_2,
    Data5=sweep1,
    Data6=sweep1_4,
    Data7=sweep1_6,
    Data8=sweep1_5,
    Data9=extrude_5,
    Data10=extrude_8,
    Data11=extrude_7,
    Data12=extrude_6,
    Data13=extrude_9,
    Data14=extrude,
    Data15=extrude_3)
result = ClusterOutput(merge_9)
